# Grasshopper definition CompositeTestPrompt.gh (Grasshopper 1.0.8)

trigger = Trigger(Interval=500, TimerInterval=500, Target=composite_text_prompt)
composite_text_prompt = Python3Script()  # -> a
# ---------- composite_text_prompt: Python ----------
"""GH output  a  -> latest prompt"""

import json, urllib.request

API = ("https://script.google.com/macros/s/"
       "AKfycbzRefutHR2kK1dcn7-T9cLcVeogb1ANOABVxaS2sOn1V8kw_orM-ENc3EKgzC7cEPzk"
       "/exec?latest=1")          # keep ?latest=1

try:
    with urllib.request.urlopen(API, timeout=5) as r:
        latest = json.loads(r.read().decode())["prompt"] or ""
except Exception as e:
    latest = "ERROR: {}".format(e)

a = latest
# ---------- end composite_text_prompt ----------
panel = Panel(composite_text_prompt)
